# Grasshopper definition Thule Loop.gh (Grasshopper 1.0.7)
# plug-ins: Squid

number_slider = Slider(6, range=1..10)
number_slider_2 = Slider(12, range=0..20)
number_slider_3 = Slider(20, range=0..20)
N = Count(18)
expression = Expression(x=N, y=number_slider, Expression="x*y")
cir = Circle(Plane=PlaneXY(0, 0, 0), Radius=number_slider_3)
pframes = PerpFrames(Curve=cir, Count=expression, Align=True)  # -> Frames, Parameters
range = Range(Domain=Domain(0, 1), Steps=N)
subtraction = Subtraction(A=number_slider_3, B=number_slider_2)
cir_2 = Circle(Plane=pframes.Frames, Radius=number_slider_2)
addition = Addition(A=number_slider_3, B=number_slider_2)
cull_i = CullIndex(List=range, Indices=-1, Wrap=True)
cir_3 = Circle(Plane=PlaneXY(0, 0, 0), Radius=[addition, subtraction])
long = LongestList(ListA=cir_2, ListB=cull_i, PaddingMode=4)  # -> ListA, ListB
pframe = PerpFrame(Curve=reparameterize(long.ListA), Parameter=long.ListB)
eval = EvaluateLength(Curve=long.ListA, Length=long.ListB, Normalized=True)  # -> Point, Tangent, Parameter
pt = Point(pframe)
deplane = DeconstructPlane(Plane=pframe)  # -> Origin, XAxis, YAxis, ZAxis
intcrv = Interpolate(Vertices=eval.Point, Degree=3, Periodic=True, KnotStyle=1)  # -> Curve, Length, Domain
line = LineSDL(Start=deplane.Origin, Direction=deplane.XAxis, Length=Slider(6, range=0..50))
eval_2 = EvaluateLength(Curve=line, Length=0.5, Normalized=True)  # -> Point, Tangent, Parameter
vec2pt = Vector2Pt(PointA=eval_2.Point, PointB=deplane.Origin, Unitize=False)  # -> Vector, Length
move = Move(Geometry=line, Motion=vec2pt.Vector)  # -> Geometry, Transform
custom_mesh_settings = SettingsCustom(
    StitchSeams=True,
    SimplePlanes=False,
    Refine=True,
    MinCount=16,
    MaxCount=400,
    AspectRatio=1,
    MaxDistance=0,
    MaxAngle=20,
    MinEdge=0,
    MaxEdge=0.3)
yz = YZPlane(Origin=Point(0, 0, 0))
xy = XYPlane(Origin=Point(0, 0, 0))
loft = Loft(
    Curves=flatten(move.Geometry),
    Options={Adjust=False, Closed=True, LoftEnds=0, LoftSimp=0, LoftType=0, Rebuild=10, Refit=0.01})
xz = XZPlane(Origin=Point(0, 0, 0))
mesh = MeshBrep(Brep=loft, Settings=custom_mesh_settings)
tri = Triangulate(Mesh=mesh)  # -> Mesh, Count
rotate = Rotate(Geometry=tri.Mesh, Angle=degrees(Slider(0, range=0..90)), Plane=xy)  # -> Geometry, Transform
rotate_2 = Rotate(Geometry=rotate.Geometry, Angle=expr("-x", degrees(Slider(0, range=0..90))), Plane=yz)  # -> Geometry, Transform
range_2 = Range(Domain=Domain(0, 1), Steps=number_slider)
item = ListItem(List=cir_3, Index=0, Wrap=True)
facen = FaceNormals(Mesh=rotate_2.Geometry)  # -> Centers, Normals
faceb = FaceBoundaries(Mesh=rotate_2.Geometry)
shatter = Shatter(Curve=reparameterize(graft(cir_3)), Parameters=range_2)  # -> flatten(Segments)
lng = ListLength(List=shatter)
random = Random(Range=Domain(0.1, 0.9), Number=lng, Seed=235)
pdecon = Deconstruct(Point=facen.Normals)  # -> XComponent, YComponent, ZComponent
eval_3 = EvaluateLength(Curve=shatter, Length=random, Normalized=True)  # -> Point, Tangent, Parameter
divide = DivideCurve(Curve=cir_3, Count=number_slider, Kinks=False)  # -> Points, Tangents, Parameters
bnd = Bounds(Numbers=pdecon.ZComponent)
A = DomainStart(40)
cir_4 = Circle(Plane=eval_3.Point, Radius=3)
dedomain = DeconstructDomain(Domain=bnd)  # -> Start, End
expression_2 = Expression(x=dedomain.End, y=Slider(3, range=0..5), Expression="x*y")
l0 = Start(5)
flip = FlipMatrix(Data=divide.Points)
dom = ConstructDomain(DomainStart=expr("-x", A), DomainEnd=A)
gradient = Gradient(
    LowerLimit=dedomain.Start,
    UpperLimit=expression_2,
    Parameter=pdecon.ZComponent,
    stops=[0: RGB(255, 255, 255), 0.893: RGB(0, 0, 0)])
pline = PolyLine(Vertices=flip, Closed=False)
X = XSize(dom)
ext = ExtendCurve(Curve=pline, Type=0, Start=l0, End=l0)
swatch = ColourSwatch(SwatchColor=RGB(255, 255, 255))
rectangle = Rectangle(Plane=PlaneXY(0, 0, 0), XSize=X, YSize=X, Radius=0)  # -> Rectangle, Length
outline = Outline(Color=gradient, Width=0.2)
panel = Panel("C:\Users\Andrew\Dropbox (COX Architecture)\LOCAL TEMP")
fills = FillSolid(Color=gradient)
fills_2 = FillSolid(Color=ColourSwatch(SwatchColor=RGB(255, 255, 255)))
outline_2 = Outline(Color=ColourSwatch(SwatchColor=RGB(242, 242, 242)), Width=0.2)
draw = Draw(Curve=rectangle.Rectangle, Accuracy=-1, Outline=swatch, Fill=swatch)  # -> SquidInstr, Curve
draw_2 = Draw(Curve=faceb, Accuracy=-1, Outline=outline, Fill=fills)  # -> SquidInstr, Curve
save = Save(Folder=panel, Filename="thule loop", Tiff=False)  # -> SquidInstr, Path
save_2 = Save(Folder=panel, Filename="thule loop2", Tiff=False)  # -> SquidInstr, Path
draw_3 = Draw(Curve=flatten([cir_3, cir, ext, cir_4]), Accuracy=-1, Outline=outline_2)  # -> SquidInstr, Curve
draw_4 = Draw(Curve=faceb, Accuracy=-1, Fill=fills_2)  # -> SquidInstr, Curve
save_3 = Save(Folder=panel, Filename="thule loop3", Tiff=False)  # -> SquidInstr, Path
merge = Merge(Data1=flatten(draw.SquidInstr), Data2=flatten(draw_2.SquidInstr), Data3=flatten(save.SquidInstr))
merge_2 = Merge(Data2=flatten(draw_2.SquidInstr), Data3=flatten(save_2.SquidInstr))
merge_3 = Merge(
    Data1=flatten(draw.SquidInstr),
    Data2=flatten(draw_3.SquidInstr),
    Data3=flatten(draw_4.SquidInstr),
    Data4=flatten(save_3.SquidInstr))
squid = Squid(BitmapR=rectangle.Rectangle, SquidInstr=merge_2, PPU=10, AA=True, autohide=False)
squid_2 = Squid(BitmapR=rectangle.Rectangle, SquidInstr=merge, PPU=10, AA=True, autohide=False)
squid_3 = Squid(BitmapR=rectangle.Rectangle, SquidInstr=merge_3, PPU=10, AA=True, autohide=False)
panel_2 = Panel(squid_2)
